# Grasshopper definition Pu.gh (Grasshopper 0.9.76)
# plug-ins: Python Interpreter, VirtualWindTunnel

# 40
number_slider = Slider(0.066, range=0..0.4)
# 10
number_slider_2 = Slider(0.264, range=0..1)
# 20
number_slider_3 = Slider(0.132, range=0..1)
# 80
number_slider_4 = Slider(0.033, range=0..0.1)
panel = Panel("C:\MeshingPaper\Pu\")
panel_5 = Panel("C:\MeshingPaper\take2\cyl\level_const\coarse\")
panel_6 = Panel("C:\MeshingPaper\take2\cyl\level_const\very_coarse\")
panel_7 = Panel("C:\MeshingPaper\take2\cyl\level_const\normal\")
panel_8 = Panel("C:\MeshingPaper\take2\cyl\level_const\fine\")
number_slider_5 = Slider(0.095, range=0..1)
number_slider_6 = Slider(0.5, range=0..1)
number_slider_7 = Slider(1, range=0..1)
number_slider_8 = Slider(0.095, range=0..1)
number_slider_9 = Slider(0.095, range=0..1)
number_slider_10 = Slider(1, range=0..1)
number_slider_11 = Slider(1, range=0..1)
toggle = BooleanToggle(True)
number_slider_12 = Slider(0.095, range=0..1)
wind_dir = ControlKnob(Decimals=0, Limit=True, Maximum=359, Minimum=0, Range=360, Value=0)
toggle_2 = BooleanToggle(True)
toggle_3 = BooleanToggle(True)
number_slider_13 = Slider(1, range=0..1)
wind_dir_2 = ControlKnob(Decimals=0, Limit=True, Maximum=359, Minimum=0, Range=360, Value=0)
wind_dir_3 = ControlKnob(Decimals=0, Limit=True, Maximum=359, Minimum=0, Range=360, Value=0)
toggle_4 = BooleanToggle(True)
wind_dir_4 = ControlKnob(Decimals=0, Limit=True, Maximum=359, Minimum=0, Range=360, Value=0)
geo = Geometry(<mesh referenced from the Rhino model>)
geo_2 = Geometry(<mesh referenced from the Rhino model>)
geo_3 = Geometry(<mesh referenced from the Rhino model>)
geo_4 = Geometry(<mesh referenced from the Rhino model>)
domaincyl = DomainCyl(
    Geometry=geo,
    Directory=panel_5,
    WindDir=wind_dir,
    DivisionsOuterCirc="27",
    DivisionsZ=10,
    ScaleInnerR=number_slider_3,
    RAM=number_slider_7,
    CPUs=number_slider_7,
    Run=toggle)  # -> Out, Domain, Cyl
domaincyl_2 = DomainCyl(
    Geometry=geo_3,
    Directory=panel_7,
    WindDir=wind_dir_2,
    DivisionsOuterCirc="60",
    DivisionsZ=10,
    ScaleInnerR=number_slider,
    RAM=number_slider_10,
    CPUs=number_slider_10,
    Run=toggle_3)  # -> Out, Domain, Cyl
domaincyl_3 = DomainCyl(
    Geometry=geo_2,
    Directory=panel_6,
    WindDir=wind_dir_3,
    DivisionsOuterCirc="10",
    DivisionsZ=10,
    ScaleInnerR=number_slider_2,
    RAM=number_slider_11,
    CPUs=number_slider_11,
    Run=toggle_2)  # -> Out, Domain, Cyl
domaincyl_4 = DomainCyl(
    Geometry=geo_4,
    Directory=panel_8,
    WindDir=wind_dir_4,
    DivisionsOuterCirc="127",
    DivisionsZ=10,
    ScaleInnerR=number_slider_4,
    RAM=number_slider_13,
    CPUs=number_slider_13,
    Run=toggle_4)  # -> Out, Domain, Cyl
clean = Clean(Dir=panel_5, Run=Button())
clean_2 = Clean(Dir=panel_6, Run=Button())
clean_3 = Clean(Dir=panel_7, Run=Button())
python = PythonScript(x=domaincyl.Domain)  # -> out, a
# ---------- python: Python ----------
a = x.equalDivisions;
# ---------- end python ----------
panel_9 = Panel(python.a)
python_2 = PythonScript(x=domaincyl_3.Domain)  # -> out, a; same code as python
clean_4 = Clean(Dir=panel_8, Run=Button())
panel_10 = Panel(python_2.a)
python_3 = PythonScript(x=domaincyl_2.Domain)  # -> out, a; same code as python
panel_11 = Panel(python_3.a)
python_4 = PythonScript(x=domaincyl_4.Domain)  # -> out, a; same code as python
cellsize = CellSize(Domain=domaincyl.Domain, BlockMeshCellSize="0.0256232426078395", DesiredCellSize="0.00625")
panel_12 = Panel(python_4.a)
number_slider_14 = Slider(2, range=0..10)
cluster = Cluster(x=domaincyl.Domain)
python_5 = PythonScript(x=domaincyl_2.Domain)  # -> out, a; same code as python
number_slider_15 = Slider(2, range=0..10)
cluster_2 = Cluster(x=domaincyl_2.Domain)
python_6 = PythonScript(x=domaincyl_3.Domain)  # -> out, a; same code as python
# zCells
cluster_3 = Cluster(x=domaincyl_3.Domain)
number_slider_16 = Slider(2, range=0..10)
cellsize_2 = CellSize(Domain=domaincyl_4.Domain, BlockMeshCellSize="0.0256232426078395", DesiredCellSize="0.00625")
number_slider_17 = Slider(2, range=0..10)
cluster_4 = Cluster(x=domaincyl_4.Domain)
panel_13 = Panel(cluster)
panel_14 = Panel(python_5.a)
cellsize_3 = CellSize(Domain=domaincyl_2.Domain, BlockMeshCellSize=panel_14, DesiredCellSize="0.00625")
panel_15 = Panel(python_6.a)
cellsize_4 = CellSize(Domain=domaincyl_3.Domain, BlockMeshCellSize=panel_15, DesiredCellSize="0.025")
panel_16 = Panel(cluster_2)
panel_17 = Panel(cluster_3)
panel_18 = Panel(cellsize)
crv = Curve(<curve referenced from the Rhino model>)
panel_19 = Panel(cluster_4)
panel_20 = Panel(cellsize_3)
panel_21 = Panel(cellsize_4)
crv_2 = Curve(<curve referenced from the Rhino model>)
crv_3 = Curve(<curve referenced from the Rhino model>)
panel_22 = Panel(cellsize_2)
divide = DivideCurve(Curve=crv, Count=Slider(50, range=0..100), Kinks=False)  # -> Points, Tangents, Parameters
mesh = Mesh(
    Domain=domaincyl.Domain,
    AccBuilding=number_slider_14,
    AccFeatures=number_slider_14,
    AccGround=Slider(2, range=0..10),
    Layer=Slider(3, range=0..10),
    Run=toggle)  # -> Out, Domain
crv_4 = Curve(<curve referenced from the Rhino model>)
divide_2 = DivideCurve(Curve=crv_2, Count=Slider(50, range=0..100), Kinks=False)  # -> Points, Tangents, Parameters
mesh_2 = Mesh(
    Domain=domaincyl_2.Domain,
    AccBuilding=number_slider_15,
    AccFeatures=number_slider_15,
    AccGround=Slider(2, range=0..10),
    Layer=Slider(3, range=0..10),
    Run=toggle_3)  # -> Out, Domain
divide_3 = DivideCurve(Curve=crv_3, Count=Slider(50, range=0..100), Kinks=False)  # -> Points, Tangents, Parameters
mesh_3 = Mesh(
    Domain=domaincyl_3.Domain,
    AccBuilding=Slider(2, range=0..10),
    AccFeatures=number_slider_16,
    AccGround=number_slider_16,
    Layer=Slider(3, range=0..10),
    Run=toggle_2)  # -> Out, Domain
divide_4 = DivideCurve(Curve=crv_4, Count=Slider(50, range=0..100), Kinks=False)  # -> Points, Tangents, Parameters
mesh_4 = Mesh(
    Domain=domaincyl_4.Domain,
    AccBuilding=number_slider_17,
    AccFeatures=number_slider_17,
    AccGround=Slider(2, range=0..10),
    Layer=Slider(3, range=0..10),
    Run=toggle_4)  # -> Out, Domain
probes = Probes(Domain=domaincyl.Domain, Points=divide.Points, PointName=1, Run=Toggle(False))
probes_2 = Probes(Domain=domaincyl_2.Domain, Points=divide_2.Points, PointName=1, Run=Toggle(False))
probes_3 = Probes(Domain=domaincyl_3.Domain, Points=divide_3.Points, PointName=1, Run=Toggle(False))
gradient = Gradient(
    LowerLimit=Slider(0, range=0..10),
    UpperLimit=Slider(13, range=0..25),
    Parameter=probes,
    stops=[0: RGB(0, 128, 0), 0.5: RGB(255, 255, 0), 1: RGB(255, 0, 0)])
abl = ABL(
    Uref=Slider(12, range=0..100),
    Zref=Slider(0.5, range=0..100),
    Z0=Slider(0.005, range=0..100),
    ZGround=Slider(0, range=0..100))
gradient_2 = Gradient(
    LowerLimit=Slider(0, range=0..10),
    UpperLimit=Slider(13, range=0..25),
    Parameter=probes_2,
    stops=[0: RGB(0, 128, 0), 0.5: RGB(255, 255, 0), 1: RGB(255, 0, 0)])
probes_4 = Probes(Domain=domaincyl_4.Domain, Points=divide_4.Points, PointName=1, Run=Toggle(False))
gradient_3 = Gradient(
    LowerLimit=Slider(0, range=0..10),
    UpperLimit=Slider(13, range=0..25),
    Parameter=probes_3,
    stops=[0: RGB(0, 128, 0), 0.5: RGB(255, 255, 0), 1: RGB(255, 0, 0)])
button = Button()
abl_2 = ABL(
    Uref=Slider(12, range=0..100),
    Zref=Slider(0.5, range=0..100),
    Z0=Slider(0.005, range=0..100),
    ZGround=Slider(0, range=0..100))
abl_3 = ABL(
    Uref=Slider(12, range=0..100),
    Zref=Slider(0.5, range=0..100),
    Z0=Slider(0.005, range=0..100),
    ZGround=Slider(0, range=0..100))
gradient_4 = Gradient(
    LowerLimit=Slider(0, range=0..10),
    UpperLimit=Slider(13, range=0..25),
    Parameter=probes_4,
    stops=[0: RGB(0, 128, 0), 0.5: RGB(255, 255, 0), 1: RGB(255, 0, 0)])
button_2 = Button()
button_3 = Button()
abl_4 = ABL(
    Uref=Slider(12, range=0..100),
    Zref=Slider(0.5, range=0..100),
    Z0=Slider(0.005, range=0..100),
    ZGround=Slider(0, range=0..100))
multiplication = Multiplication(A=probes, B=Slider(0.01, range=0..1))
button_4 = Button()
multiplication_2 = Multiplication(A=probes_2, B=Slider(0.01, range=0..1))
multiplication_3 = Multiplication(A=probes_3, B=Slider(0.01, range=0..1))
simulation = Simulation(
    Domain=mesh.Domain,
    Iterations=Slider(7659, range=0..10000),
    WriteInterval=Slider(26, range=0..100),
    KeepTimeSteps=Slider(4, range=0..10),
    Mode=0,
    Bcond=abl,
    Run=toggle)
multiplication_4 = Multiplication(A=probes_4, B=Slider(0.01, range=0..1))
simulation_2 = Simulation(
    Domain=mesh_2.Domain,
    Iterations=Slider(7659, range=0..10000),
    WriteInterval=Slider(26, range=0..100),
    KeepTimeSteps=Slider(4, range=0..10),
    Mode=0,
    Bcond=abl_2,
    Run=toggle_3)
simulation_3 = Simulation(
    Domain=mesh_3.Domain,
    Iterations=Slider(7659, range=0..10000),
    WriteInterval=Slider(26, range=0..100),
    KeepTimeSteps=Slider(4, range=0..10),
    Mode=0,
    Bcond=abl_3,
    Run=toggle_2)
residualwriter = ResidualWriter(WorkingDir=panel_5, Mode=0)
simulation_4 = Simulation(
    Domain=mesh_4.Domain,
    Iterations=Slider(7659, range=0..10000),
    WriteInterval=Slider(26, range=0..100),
    KeepTimeSteps=Slider(4, range=0..10),
    Mode=0,
    Bcond=abl_4,
    Run=toggle_4)
vdisex = VectorDisplayEx(Point=divide.Points, Vector=multiplication, Colour=gradient, Width=2)
residualwriter_2 = ResidualWriter(WorkingDir=panel_7, Mode=0)
residualwriter_3 = ResidualWriter(WorkingDir=panel_6, Mode=0)
vdisex_2 = VectorDisplayEx(Point=divide_2.Points, Vector=multiplication_2, Colour=gradient_2, Width=2)
vdisex_3 = VectorDisplayEx(Point=divide_3.Points, Vector=multiplication_3, Colour=gradient_3, Width=2)
residualwriter_4 = ResidualWriter(WorkingDir=panel_8, Mode=0)
vdisex_4 = VectorDisplayEx(Point=divide_4.Points, Vector=multiplication_4, Colour=gradient_4, Width=2)
# 40
number_slider_18 = Slider(0.066, range=0..0.1)  # disabled
# take2
# 10
number_slider_19 = Slider(0.264, range=0..1)  # disabled
# 20
number_slider_20 = Slider(0.132, range=0..1)  # disabled
number_slider_21 = Slider(0.033, range=0..0.1)  # disabled
number_slider_22 = Slider(2, range=0..10)  # disabled
number_slider_23 = Slider(2, range=0..10)  # disabled
number_slider_24 = Slider(3, range=0..10)  # disabled
# 40
number_slider_25 = Slider(0.332, range=0..0.4)
# 10
number_slider_26 = Slider(0.332, range=0..1)
# 20
number_slider_27 = Slider(0.132, range=0..1)  # disabled
# 80
number_slider_28 = Slider(0.033, range=0..0.1)  # disabled
panel_27 = Panel("C:\MeshingPaper\take2\cyl\coarse")
panel_28 = Panel("C:\MeshingPaper\take2\cyl\normal\")
panel_29 = Panel("C:\MeshingPaper\take2\cyl\very_coarse")
panel_30 = Panel("C:\MeshingPaper\take2\cyl\fine\")
number_slider_29 = Slider(0.095, range=0..1)
number_slider_30 = Slider(0.5, range=0..1)
number_slider_31 = Slider(0.095, range=0..1)
number_slider_32 = Slider(1, range=0..1)
number_slider_33 = Slider(0.095, range=0..1)
number_slider_34 = Slider(1, range=0..1)
number_slider_35 = Slider(1, range=0..1)
toggle_5 = BooleanToggle(True)
number_slider_36 = Slider(0.095, range=0..1)
wind_dir_5 = ControlKnob(Decimals=0, Limit=True, Maximum=359, Minimum=0, Range=360, Value=0)
toggle_6 = BooleanToggle(False)
toggle_7 = BooleanToggle(True)
number_slider_37 = Slider(1, range=0..1)
wind_dir_6 = ControlKnob(Decimals=0, Limit=True, Maximum=359, Minimum=0, Range=360, Value=0)
wind_dir_7 = ControlKnob(Decimals=0, Limit=True, Maximum=359, Minimum=0, Range=360, Value=0)
toggle_8 = BooleanToggle(True)
wind_dir_8 = ControlKnob(Decimals=0, Limit=True, Maximum=359, Minimum=0, Range=360, Value=0)
geo_5 = Geometry(<mesh referenced from the Rhino model>)
geo_6 = Geometry(<mesh referenced from the Rhino model>)
geo_7 = Geometry(<mesh referenced from the Rhino model>)
geo_8 = Geometry(<mesh referenced from the Rhino model>)
domaincyl_5 = DomainCyl(
    Geometry=geo_5,
    Directory=panel_27,
    WindDir=wind_dir_5,
    DivisionsOuterCirc="31",
    DivisionsZ=10,
    ScaleInnerR=number_slider_26,
    RAM=number_slider_32,
    CPUs=number_slider_32,
    Run=toggle_5)  # -> Out, Domain, Cyl
domaincyl_6 = DomainCyl(
    Geometry=geo_7,
    Directory=panel_28,
    WindDir=wind_dir_6,
    DivisionsOuterCirc="63",
    DivisionsZ=10,
    ScaleInnerR=number_slider_26,
    RAM=number_slider_34,
    CPUs=number_slider_34,
    Run=toggle_7)  # -> Out, Domain, Cyl
domaincyl_7 = DomainCyl(
    Geometry=geo_6,
    Directory=panel_29,
    WindDir=wind_dir_7,
    DivisionsOuterCirc="7",
    DivisionsZ=10,
    ScaleInnerR=number_slider_26,
    RAM=number_slider_35,
    CPUs=number_slider_35,
    Run=toggle_6)  # -> Out, Domain, Cyl
domaincyl_8 = DomainCyl(
    Geometry=geo_8,
    Directory=panel_30,
    WindDir=wind_dir_8,
    DivisionsOuterCirc="126",
    DivisionsZ=10,
    ScaleInnerR=number_slider_26,
    RAM=number_slider_37,
    CPUs=number_slider_37,
    Run=toggle_8)  # -> Out, Domain, Cyl
clean_5 = Clean(Dir=panel_27, Run=Button())
clean_6 = Clean(Dir=panel_29, Run=Button())
clean_7 = Clean(Dir=panel_28, Run=Button())
python_7 = PythonScript(x=domaincyl_5.Domain)  # -> out, a; same code as python
panel_31 = Panel(python_7.a)
clean_8 = Clean(Dir=panel_30, Run=Button())
python_8 = PythonScript(x=domaincyl_6.Domain)  # -> out, a; same code as python
panel_32 = Panel(python_8.a)
python_9 = PythonScript(x=domaincyl_7.Domain)  # -> out, a; same code as python
panel_33 = Panel(python_9.a)
python_10 = PythonScript(x=domaincyl_8.Domain)  # -> out, a; same code as python
panel_34 = Panel(python_10.a)
python_11 = PythonScript(x=domaincyl_7.Domain, y=domaincyl_5.Domain)  # -> out, a; same code as python
number_slider_38 = Slider(2, range=0..10)
cluster_5 = Cluster(x=domaincyl_5.Domain)
number_slider_39 = Slider(2, range=0..10)
python_12 = PythonScript(x=domaincyl_6.Domain)  # -> out, a; same code as python
number_slider_40 = Slider(2, range=0..10)
number_slider_41 = Slider(2, range=0..10)
cluster_6 = Cluster(x=domaincyl_6.Domain)
python_13 = PythonScript(x=domaincyl_7.Domain)  # -> out, a; same code as python
# Cyl
# zCells
cluster_7 = Cluster(x=domaincyl_7.Domain)
number_slider_42 = Slider(2, range=0..10)
number_slider_43 = Slider(2, range=0..10)
python_14 = PythonScript(x=domaincyl_8.Domain)  # -> out, a; same code as python
panel_35 = Panel(python_11.a)
cellsize_5 = CellSize(Domain=domaincyl_5.Domain, BlockMeshCellSize=panel_35, DesiredCellSize="0.0125")
number_slider_44 = Slider(2, range=0..10)
cluster_8 = Cluster(x=domaincyl_8.Domain)
number_slider_45 = Slider(2, range=0..10)
panel_36 = Panel(cluster_5)
panel_37 = Panel(python_12.a)
cellsize_6 = CellSize(Domain=domaincyl_6.Domain, BlockMeshCellSize=panel_37, DesiredCellSize="0.00625")
panel_38 = Panel(python_13.a)
cellsize_7 = CellSize(Domain=domaincyl_7.Domain, BlockMeshCellSize=panel_38, DesiredCellSize="0.025")
panel_39 = Panel(cluster_6)
panel_40 = Panel(cluster_7)
panel_41 = Panel(python_14.a)
cellsize_8 = CellSize(Domain=domaincyl_8.Domain, BlockMeshCellSize=panel_41, DesiredCellSize="0.003125")
panel_42 = Panel(cellsize_5)
crv_5 = Curve(<curve referenced from the Rhino model>)
panel_43 = Panel(cluster_8)
panel_44 = Panel(cellsize_6)
crv_6 = Curve(<curve referenced from the Rhino model>)
crv_7 = Curve(<curve referenced from the Rhino model>)
panel_45 = Panel(cellsize_7)
panel_46 = Panel(cellsize_8)
divide_5 = DivideCurve(Curve=crv_5, Count=Slider(50, range=0..100), Kinks=False)  # -> Points, Tangents, Parameters
mesh_5 = Mesh(
    Domain=domaincyl_5.Domain,
    AccBuilding=cellsize_5,
    AccFeatures=cellsize_5,
    AccGround=cellsize_5,
    Layer=Slider(3, range=0..10),
    Run=toggle_5)  # -> Out, Domain
crv_8 = Curve(<curve referenced from the Rhino model>)
divide_6 = DivideCurve(Curve=crv_6, Count=Slider(50, range=0..100), Kinks=False)  # -> Points, Tangents, Parameters
mesh_6 = Mesh(
    Domain=domaincyl_6.Domain,
    AccBuilding=cellsize_6,
    AccFeatures=cellsize_6,
    AccGround=cellsize_6,
    Layer=Slider(3, range=0..10),
    Run=toggle_7)  # -> Out, Domain
divide_7 = DivideCurve(Curve=crv_7, Count=Slider(50, range=0..100), Kinks=False)  # -> Points, Tangents, Parameters
mesh_7 = Mesh(
    Domain=domaincyl_7.Domain,
    AccBuilding=cellsize_7,
    AccFeatures=cellsize_7,
    AccGround=cellsize_7,
    Layer=Slider(3, range=0..10),
    Run=toggle_6)  # -> Out, Domain
divide_8 = DivideCurve(Curve=crv_8, Count=Slider(50, range=0..100), Kinks=False)  # -> Points, Tangents, Parameters
mesh_8 = Mesh(
    Domain=domaincyl_8.Domain,
    AccBuilding=cellsize_8,
    AccFeatures=cellsize_8,
    AccGround=cellsize_8,
    Layer=Slider(3, range=0..10),
    Run=toggle_8)  # -> Out, Domain
probes_5 = Probes(Domain=domaincyl_5.Domain, Points=divide_5.Points, PointName=1, Run=Toggle(False))
probes_6 = Probes(Domain=domaincyl_6.Domain, Points=divide_6.Points, PointName=1, Run=Toggle(False))
probes_7 = Probes(Domain=domaincyl_7.Domain, Points=divide_7.Points, PointName=1, Run=Toggle(False))
gradient_5 = Gradient(
    LowerLimit=Slider(0, range=0..10),
    UpperLimit=Slider(13, range=0..25),
    Parameter=probes_5,
    stops=[0: RGB(0, 128, 0), 0.5: RGB(255, 255, 0), 1: RGB(255, 0, 0)])
abl_5 = ABL(
    Uref=Slider(12, range=0..100),
    Zref=Slider(0.5, range=0..100),
    Z0=Slider(0.005, range=0..100),
    ZGround=Slider(0, range=0..100))
gradient_6 = Gradient(
    LowerLimit=Slider(0, range=0..10),
    UpperLimit=Slider(13, range=0..25),
    Parameter=probes_6,
    stops=[0: RGB(0, 128, 0), 0.5: RGB(255, 255, 0), 1: RGB(255, 0, 0)])
probes_8 = Probes(Domain=domaincyl_8.Domain, Points=divide_8.Points, PointName=1, Run=Toggle(False))
gradient_7 = Gradient(
    LowerLimit=Slider(0, range=0..10),
    UpperLimit=Slider(13, range=0..25),
    Parameter=probes_7,
    stops=[0: RGB(0, 128, 0), 0.5: RGB(255, 255, 0), 1: RGB(255, 0, 0)])
button_5 = Button()
abl_6 = ABL(
    Uref=Slider(12, range=0..100),
    Zref=Slider(0.5, range=0..100),
    Z0=Slider(0.005, range=0..100),
    ZGround=Slider(0, range=0..100))
abl_7 = ABL(
    Uref=Slider(12, range=0..100),
    Zref=Slider(0.5, range=0..100),
    Z0=Slider(0.005, range=0..100),
    ZGround=Slider(0, range=0..100))
gradient_8 = Gradient(
    LowerLimit=Slider(0, range=0..10),
    UpperLimit=Slider(13, range=0..25),
    Parameter=probes_8,
    stops=[0: RGB(0, 128, 0), 0.5: RGB(255, 255, 0), 1: RGB(255, 0, 0)])
button_6 = Button()
button_7 = Button()
abl_8 = ABL(
    Uref=Slider(12, range=0..100),
    Zref=Slider(0.5, range=0..100),
    Z0=Slider(0.005, range=0..100),
    ZGround=Slider(0, range=0..100))
multiplication_5 = Multiplication(A=probes_5, B=Slider(0.01, range=0..1))
button_8 = Button()
multiplication_6 = Multiplication(A=probes_6, B=Slider(0.01, range=0..1))
multiplication_7 = Multiplication(A=probes_7, B=Slider(0.01, range=0..1))
simulation_5 = Simulation(
    Domain=mesh_5.Domain,
    Iterations=Slider(7659, range=0..10000),
    WriteInterval=Slider(26, range=0..100),
    KeepTimeSteps=Slider(4, range=0..10),
    Mode=0,
    Bcond=abl_5,
    Run=toggle_5)
multiplication_8 = Multiplication(A=probes_8, B=Slider(0.01, range=0..1))
simulation_6 = Simulation(
    Domain=mesh_6.Domain,
    Iterations=Slider(7659, range=0..10000),
    WriteInterval=Slider(26, range=0..100),
    KeepTimeSteps=Slider(4, range=0..10),
    Mode=0,
    Bcond=abl_6,
    Run=toggle_7)
simulation_7 = Simulation(
    Domain=mesh_7.Domain,
    Iterations=Slider(7659, range=0..10000),
    WriteInterval=Slider(26, range=0..100),
    KeepTimeSteps=Slider(4, range=0..10),
    Mode=0,
    Bcond=abl_7,
    Run=toggle_6)
residualwriter_5 = ResidualWriter(WorkingDir=panel_27, Mode=0)
simulation_8 = Simulation(
    Domain=mesh_8.Domain,
    Iterations=Slider(7659, range=0..10000),
    WriteInterval=Slider(26, range=0..100),
    KeepTimeSteps=Slider(4, range=0..10),
    Mode=0,
    Bcond=abl_8,
    Run=toggle_8)
vdisex_5 = VectorDisplayEx(Point=divide_5.Points, Vector=multiplication_5, Colour=gradient_5, Width=2)
residualwriter_6 = ResidualWriter(WorkingDir=panel_28, Mode=0)
residualwriter_7 = ResidualWriter(WorkingDir=panel_29, Mode=0)
vdisex_6 = VectorDisplayEx(Point=divide_6.Points, Vector=multiplication_6, Colour=gradient_6, Width=2)
vdisex_7 = VectorDisplayEx(Point=divide_7.Points, Vector=multiplication_7, Colour=gradient_7, Width=2)
residualwriter_8 = ResidualWriter(WorkingDir=panel_30, Mode=0)
vdisex_8 = VectorDisplayEx(Point=divide_8.Points, Vector=multiplication_8, Colour=gradient_8, Width=2)
toggle_9 = BooleanToggle(True)
panel_47 = Panel("C:\MeshingPaper\take2\box\fine\")
panel_48 = Panel("C:\MeshingPaper\take2\box\normal\")
panel_49 = Panel("C:\MeshingPaper\take2\box\coarse\")
panel_50 = Panel("C:\MeshingPaper\take2\box\very_coarse\")
geo_9 = Geometry(<mesh referenced from the Rhino model>)
toggle_10 = BooleanToggle(True)
num = Number("1")
geo_10 = Geometry(<mesh referenced from the Rhino model>)
toggle_11 = BooleanToggle(True)
geo_11 = Geometry(<mesh referenced from the Rhino model>)
num_2 = Number("1")
clean_9 = Clean(Dir=panel_50, Run=Button())
num_3 = Number("1")
toggle_12 = BooleanToggle(True)
# Box
domainbox = DomainBox(Geometry=geo_9, Directory=panel_50, BaseMesh="0.1", RAM=num, CPUs=1, Run=toggle_9)  # -> Out, Domain, Cyl, D, E
domainbox_2 = DomainBox(Geometry=geo_10, Directory=panel_49, BaseMesh="0.05", RAM=num_2, CPUs=1, Run=toggle_9)  # -> Out, Domain, Cyl, D, E
geo_12 = Geometry(<mesh referenced from the Rhino model>)
clean_10 = Clean(Dir=panel_49, Run=Button())
domainbox_3 = DomainBox(Geometry=geo_11, Directory=panel_48, BaseMesh="0.025", RAM=num_3, CPUs=1, Run=toggle_9)  # -> Out, Domain, Cyl, D, E
num_4 = Number("1")
clean_11 = Clean(Dir=panel_48, Run=Button())
domainbox_4 = DomainBox(Geometry=geo_12, Directory=panel_47, BaseMesh="0.125", RAM=num_4, CPUs=1, Run=toggle_9)  # -> Out, Domain, Cyl, D, E
clean_12 = Clean(Dir=panel_47, Run=Button())
mesh_9 = Mesh(Domain=domainbox.Domain, AccBuilding="2", AccFeatures="2", AccGround="2", Layer="3", Run=toggle_9)  # -> Out, Domain
mesh_10 = Mesh(Domain=domainbox_2.Domain, AccBuilding="2", AccFeatures="2", AccGround="2", Layer="3", Run=toggle_9)  # -> Out, Domain
mesh_11 = Mesh(Domain=domainbox_3.Domain, AccBuilding="2", AccFeatures="2", AccGround="2", Layer="3", Run=toggle_9)  # -> Out, Domain
mesh_12 = Mesh(Domain=domainbox_4.Domain, AccBuilding="2", AccFeatures="2", AccGround="2", Layer="3", Run=toggle_9)  # -> Out, Domain
abl_9 = ABL(
    Uref=Slider(12, range=0..100),
    Zref=Slider(0.5, range=0..100),
    Z0=Slider(0.005, range=0..100),
    ZGround=Slider(0, range=0..100))
abl_10 = ABL(
    Uref=Slider(12, range=0..100),
    Zref=Slider(0.5, range=0..100),
    Z0=Slider(0.005, range=0..100),
    ZGround=Slider(0, range=0..100))
abl_11 = ABL(
    Uref=Slider(12, range=0..100),
    Zref=Slider(0.5, range=0..100),
    Z0=Slider(0.005, range=0..100),
    ZGround=Slider(0, range=0..100))
abl_12 = ABL(
    Uref=Slider(12, range=0..100),
    Zref=Slider(0.5, range=0..100),
    Z0=Slider(0.005, range=0..100),
    ZGround=Slider(0, range=0..100))
simulation_9 = Simulation(
    Domain=mesh_9.Domain,
    Iterations=Slider(7659, range=0..10000),
    WriteInterval=Slider(26, range=0..100),
    KeepTimeSteps=Slider(4, range=0..10),
    Mode=0,
    Bcond=abl_9,
    Run=toggle_9)
simulation_10 = Simulation(
    Domain=mesh_10.Domain,
    Iterations=Slider(7659, range=0..10000),
    WriteInterval=Slider(26, range=0..100),
    KeepTimeSteps=Slider(4, range=0..10),
    Mode=0,
    Bcond=abl_10,
    Run=toggle_9)
residualwriter_9 = ResidualWriter(WorkingDir=panel_50, Mode=0)
simulation_11 = Simulation(
    Domain=mesh_11.Domain,
    Iterations=Slider(7659, range=0..10000),
    WriteInterval=Slider(26, range=0..100),
    KeepTimeSteps=Slider(4, range=0..10),
    Mode=0,
    Bcond=abl_11,
    Run=toggle_9)
residualwriter_10 = ResidualWriter(WorkingDir=panel_49, Mode=0)
residualwriter_11 = ResidualWriter(WorkingDir=panel_48, Mode=0)
simulation_12 = Simulation(
    Domain=mesh_12.Domain,
    Iterations=Slider(7659, range=0..10000),
    WriteInterval=Slider(26, range=0..100),
    KeepTimeSteps=Slider(4, range=0..10),
    Mode=0,
    Bcond=abl_12,
    Run=toggle_9)
residualwriter_12 = ResidualWriter(WorkingDir=panel_47, Mode=0)

# ==== cluster Cluster
x = ClusterInput()
python = PythonScript(x=x)  # -> out, a
# ---------- python: Python ----------
a = x.cellSizeInner;
# ---------- end python ----------
division = Division(A="1.5", B=python.a)
round = Round(Number=division)  # -> Nearest, Floor, Ceiling
N = ClusterOutput(round.Nearest)
