# Grasshopper definition 3_SimpleWindAnalysis.ghx (Grasshopper 1.0.7)
# plug-ins: Eddy3D

# ----
# 1. Geometry &
# Boundary Conditions
abl = ABL(WDir=Slider(24, range=0..100), Uref=5, Zref=10, Z0=1, ZGround=0)

cluster = Cluster_4()

# ----
# 2. Simulation Domain
domainbox = BoxShapedDomain(Geometry=cluster, BoundaryCondition=abl, BlockSize=20)  # -> Domain, Mesh

# ----
# 3. Mesh & Simulation
panel = Panel("2000")
panel_2 = Panel("C:\Eddy3D-Cases\3_SimpleWindAnalysis")
rset = RunSettings(
    NumberOfIterations=panel,
    WriteInterval=20,
    NumberOfTimestepsToKeep=3,
    TurbulenceModel=1,
    RelaxationFactors=3,
    SolutionAndAlgorithmControl=0,
    PotentialFoamInitialization=False,
    AgeOfAir=False,
    NumberOfCPUs="-1",
    OperatingSystem=0)

mset = MeshSettings(AccBuilding=2, AccFeatures="3", AccBBox=0, AccGround="3", MiscSettings=1, NumberOfLayers=4, Mode=2)

simulation = Simulation(
    SimulationDomain=domainbox.Domain,
    WorkingDirectory=panel_2,
    MeshSettings=mset,
    RunSettings=rset,
    RunMeshing=Button(),
    MakeTrees=False,
    RunSimulation=Button(),
    runWithBlueCFD=True)
residuals = Residuals(Result=simulation, X=":", Y=":", Version=1, Run=Button(), visResiduals=True)

# ----
# 6. Clean
button = Button()
clean = Clean(Directory=panel_2, Mode=2, Run=button)

# ----
# 4. Probing points & probing
number_slider = Slider(5, range=1..30)
brep = Brep(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)
mjoin = MeshJoin(Meshes=cluster)
brep_2 = Brep(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)

cluster_2 = Cluster_3(bm=mjoin, brep=brep_2, number=number_slider)

probing = Probing(Result=simulation, ProbingPoints=cluster_2, NameOfInstance="ttt", NameOfField=0, Run=Button())  # -> PorbingPoints, ProbingResult

# ----
# 5. Post-processing
# 5.1. Paraview
# 5.2. Grasshopper
# Wind vectors
points = Data(probing.PorbingPoints)
vectors = Data(probing.ProbingResult)
cluster_3 = Cluster(data=vectors)  # -> S, E, data_3
gradient = Gradient(
    LowerLimit=cluster_3.S,
    UpperLimit=Slider(5, range=0..10),
    Parameter=cluster_3.data_3,
    stops=[0.103: RGB(0, 0, 255), 0.22: RGB(0, 170, 255), 0.305: RGB(0, 255, 255), 0.398: RGB(0, 255, 188), 0.504: RGB(0, 255, 106), 0.605: RGB(91, 255, 0), 0.699: RGB(184, 255, 0), 0.799: RGB(255, 255, 0), 0.898: RGB(255, 170, 0)])
vdisex = VectorDisplayEx(Point=points, Vector=vectors, Colour=gradient, Width=Slider(2, range=0..10))

paraview = Paraview(Result=simulation, ParaviewVersion=2, Run=Button())

# ==== cluster Cluster
data = ClusterInput()
data_2 = Data(data)
data_3 = ClusterOutput(data_2)
bnd = Bounds(Numbers=data_2)
dedomain = DeconstructDomain(Domain=bnd)  # -> Start, End
S = ClusterOutput(dedomain.Start)
E = ClusterOutput(dedomain.End)

# ==== cluster Cluster_3
brep = ClusterInput()
number = ClusterInput()
cluster = Cluster_2(brep=brep, number=number)
bm = ClusterInput()
probing = Probing(BuildingMesh=bm, GroundMesh=cluster, ConvertQuadsToTriangles=False)
demesh = DeconstructMesh(Mesh=probing)  # -> Vertices, Faces, Colours, Normals
V = ClusterOutput(demesh.Vertices)

# ==== cluster Cluster_4
geo = Geometry([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])
mesh = Mesh(geo)
mjoin = MeshJoin(Meshes=mesh)
M = ClusterOutput(mjoin)

# ==== cluster Cluster_2
number = ClusterInput()
number_2 = Number(number)
settings_custom = SettingsCustom(
    StitchSeams=True,
    SimplePlanes=False,
    Refine=True,
    MinCount=16,
    MaxCount=400,
    AspectRatio=20,
    MaxDistance=0,
    MaxAngle=20,
    MinEdge=number_2,
    MaxEdge=number_2)
brep = ClusterInput()
mesh_brep = MeshBrep(Brep=brep, Settings=settings_custom)
mesh = ClusterOutput(mesh_brep)
