# Grasshopper definition 4_AnnualWindAnalysis.ghx (Grasshopper 1.0.8)
# plug-ins: Eddy3D

# 0. Download Weather
panel = Panel("https://energyplus-weather.s3.amazonaws.com/asia_wmo_region_2/IND/IND_Ahmedabad.426470_IWEC/IND_Ahmedabad.426470_IWEC.epw")
c_script = CSharpScript(url=panel)  # -> out, epwPath; inputs url: String, saveTo: String
# ---------- c_script: C# ----------
// Grasshopper Script Instance
#region Usings
using System;
using System.Linq;
using System.Collections;
using System.Collections.Generic;
using System.Drawing;
using System.IO;
using System.Net.Http;
using System.Threading.Tasks;

using Rhino;
using Rhino.Geometry;

using Grasshopper;
using Grasshopper.Kernel;
using Grasshopper.Kernel.Data;
using Grasshopper.Kernel.Types;
#endregion

public class Script_Instance : GH_ScriptInstance
{
private void RunScript(string url, string saveTo, ref object epwPath)
{
  epwPath = null;

  try
  {
    // --- Validate URL ---
    if (string.IsNullOrWhiteSpace(url))
    {
      Print("URL is invalid.");
      return;
    }

    string urlFileName;
    try { urlFileName = System.IO.Path.GetFileName(new Uri(url).LocalPath); }
    catch { Print("URL is invalid."); return; }
    if (string.IsNullOrWhiteSpace(urlFileName)) urlFileName = "download.epw";

    // --- Decide destination path ---
    string filePath;

    if (string.IsNullOrWhiteSpace(saveTo))
    {
      // Use GH file's directory
      var ghDoc  = GrasshopperDocument; // <-- use this in C# Script
      var ghPath = ghDoc?.FilePath;

      if (string.IsNullOrEmpty(ghPath))
      {
        // fallback to Rhino document folder if available
        var rhPath = Rhino.RhinoDoc.ActiveDoc?.Path;
        var rhDir  = string.IsNullOrEmpty(rhPath) ? null : System.IO.Path.GetDirectoryName(rhPath);
        if (string.IsNullOrEmpty(rhDir))
        {
          Print("Grasshopper file is unsaved. Please save the .gh file or provide a destination path.");
          return;
        }
        Print("Grasshopper file is unsaved; saving to the Rhino document folder.");
        filePath = System.IO.Path.Combine(rhDir, urlFileName);
      }
      else
      {
        var ghDir = System.IO.Path.GetDirectoryName(ghPath);
        filePath  = System.IO.Path.Combine(ghDir, urlFileName);
      }
    }
    else
    {
      // Accept either a folder or a full file path
      string raw = saveTo.Trim().Trim('"');
      raw = Environment.ExpandEnvironmentVariables(raw);

      var ghDoc  = GrasshopperDocument; // <-- use this here too
      var ghPath = ghDoc?.FilePath;
      string baseRoot = !string.IsNullOrEmpty(ghPath)
        ? System.IO.Path.GetDirectoryName(ghPath)
        : System.IO.Directory.GetCurrentDirectory();

      string candidate = raw;
      if (!System.IO.Path.IsPathRooted(candidate))
        candidate = System.IO.Path.GetFullPath(System.IO.Path.Combine(baseRoot, candidate));

      bool endsWithSlash =
        candidate.EndsWith(System.IO.Path.DirectorySeparatorChar.ToString()) ||
        candidate.EndsWith(System.IO.Path.AltDirectorySeparatorChar.ToString());

      bool treatAsFolder = endsWithSlash || System.IO.Directory.Exists(candidate);

      if (treatAsFolder)
      {
        System.IO.Directory.CreateDirectory(candidate);
        filePath = System.IO.Path.Combine(candidate, urlFileName);
      }
      else
      {
        string dir = System.IO.Path.GetDirectoryName(candidate);
        if (!string.IsNullOrEmpty(dir)) System.IO.Directory.CreateDirectory(dir);
        filePath = candidate;
      }
    }

    // --- Skip download if exists ---
    if (System.IO.File.Exists(filePath))
    {
      Print($"File already exists at {filePath}, skipping download.");
      epwPath = filePath;
      return;
    }

    // --- Download synchronously ---
    using (var http = new System.Net.Http.HttpClient())
    using (var resp = http.GetAsync(url, System.Net.Http.HttpCompletionOption.ResponseHeadersRead).Result)
    {
      resp.EnsureSuccessStatusCode();
      using (var fs = new System.IO.FileStream(filePath, System.IO.FileMode.Create, System.IO.FileAccess.Write, System.IO.FileShare.None))
      {
        resp.Content.CopyToAsync(fs).Wait();
      }
    }

    Print($"File downloaded successfully to {filePath}");
    epwPath = filePath;
  }
  catch (Exception ex)
  {
    Print($"Failed to download file: {ex.Message}");
  }
}


}

public static class FileDownloader
{
    /// <summary>
    /// Asynchronously downloads a file from the specified URL and saves it to the given file path.
    /// </summary>
    /// <param name="url">The URL of the file to download.</param>
    /// <param name="filePath">The local file path to save the downloaded file.</param>
    public static async Task DownloadFileAsync(string url, string filePath)
    {
        // Validate inputs
        if (string.IsNullOrWhiteSpace(url))
            throw new ArgumentException("URL cannot be null or empty.", nameof(url));

        if (string.IsNullOrWhiteSpace(filePath))
            throw new ArgumentException("File path cannot be null or empty.", nameof(filePath));

        // Ensure the directory exists
        var directory = Path.GetDirectoryName(filePath);
        if (!string.IsNullOrEmpty(directory) && !Directory.Exists(directory))
        {
            Directory.CreateDirectory(directory);
        }

        try
        {
            // Download file using HttpClient
            using var httpClient = new HttpClient();
            using var response = await httpClient.GetAsync(url, HttpCompletionOption.ResponseHeadersRead);
            response.EnsureSuccessStatusCode();

            // Save the file
            await using var fileStream = new FileStream(filePath, FileMode.Create, FileAccess.Write, FileShare.None);
            await response.Content.CopyToAsync(fileStream);
        }
        catch (Exception ex)
        {
            Console.WriteLine($"Error downloading file: {ex.Message}");
            throw;
        }
    }
}
# ---------- end c_script ----------

# ----
# 1. Geometry &
# Boundary Conditions
panel_2 = Panel("""0
45
90
135
180
225
270
315""")

panel_3 = Panel("""5
6
4
3
5
4
6""")
cluster = Cluster_4()
abl_flow = ABLFlow(WindDirections=panel_2, ReferenceVelocityAtZref_m_s=panel_3, Epw=c_script.epwPath)

# ----
# 3. Mesh & Simulation
panel_4 = Panel("C:\Eddy3D-Cases\4_AnnualWindAnalysis")

rset = RunSettings(
    NumberOfIterations="1000",
    WriteInterval=20,
    NumberOfTimestepsToKeep=3,
    TurbulenceModel=2,
    RelaxationFactors=2,
    SolutionAndAlgorithmControl=1,
    PotentialFoamInitialization=False,
    AgeOfAir=False,
    NumberOfCPUs="8",
    OperatingSystem=0)

# ----
# 4. Probing points & probing
button = Button()

# ----
# 6. Clean
button_2 = Button()
clean = Clean(Directory=panel_4, Mode=2, Run=button_2)

panel_5 = Panel("10")

# ----
# 2. Simulation Domain
number_slider = Slider(70, range=0..1000)
number_slider_2 = Slider(1000, range=0..1000)
number_slider_3 = Slider(2, range=0..10)

domaincyl = CylindricalDomain(
    Geometry=cluster,
    BoundaryCondition=abl_flow,
    BlockSize="15",
    SizeOfInnerRectangle=number_slider,
    SizeOfOuterRadius=number_slider_2,
    Height=Slider(250, range=0..1000),
    RadialMultiplier=2,
    DivisionsX=1)  # -> Domain, Mesh

cellsize = CellSize(SimulationDomain=domaincyl.Domain, BlockSize="15", DesiredCellSize=number_slider_3)  # -> Accuracy, Accuracy1

cellsize_2 = CellSize(SimulationDomain=domaincyl.Domain, BlockSize="15", DesiredCellSize=number_slider_3)  # -> Accuracy, Accuracy1
mset = MeshSettings(
    AccBuilding=cellsize.Accuracy,
    AccFeatures=cellsize.Accuracy1,
    AccBBox=0,
    AccGround=cellsize.Accuracy,
    MiscSettings=1,
    NumberOfLayers=4,
    Mode=1)
simulation = Simulation(
    SimulationDomain=domaincyl.Domain,
    WorkingDirectory=panel_4,
    MeshSettings=mset,
    RunSettings=rset,
    RunMeshing=Button(),
    MakeTrees=False,
    RunSimulation=Button(),
    runWithBlueCFD=True)
residuals = VisualizeResiduals(Result=simulation, X="0", Y=":", Version=0, Run=Button(), visResiduals=True)
cluster_2 = Cluster_5(R=number_slider_2, G=domaincyl.Mesh)
probing = Probing(BuildingMesh=cluster, GroundMesh=cluster_2, TargetCount=Slider(5261, range=0..10000), ConvertQuadsToTriangles=True)
demesh = DeconstructMesh(Mesh=probing)  # -> Vertices, Faces, Colours, Normals
probing_2 = Probing(Result=simulation, ProbingPoints=demesh.Vertices, NameOfInstance="ttt", InterpolationScheme=2, NameOfField=0, Run=button)  # -> ProbingPoints, ProbingResult

# ----
# 5. Post-processing
# 5.1. Paraview
# Multi-directional / annual wind vectors
# 5.2. Grasshopper
# Set to -1 for average of entire year (takes 30 s to compute)
dir = Slider(4, range=0..7)
button_3 = Button()  # disabled
vectors = Data(probing_2.ProbingResult)
points = Data(probing_2.ProbingPoints)
paraview = Paraview(Result=simulation, ParaviewVersion=2, Run=button_3)  # disabled
choose_dir = TreeBranch(Tree=vectors, Path=dir, MaintainPaths=True)
wind_factors = WindFactors(Result=simulation, ProbingPoints=points, WindVelocity=vectors, Run=Button(), Interpolation=True)  # -> WindFactorsSpatial, WindFactorsAnnual
cluster_3 = Cluster(data=choose_dir)  # -> S, E, data_3
gradient = Gradient(
    LowerLimit=cluster_3.S,
    UpperLimit=cluster_3.E,
    Parameter=cluster_3.data_3,
    stops=[0.103: RGB(0, 0, 255), 0.22: RGB(0, 170, 255), 0.305: RGB(0, 255, 255), 0.398: RGB(0, 255, 188), 0.504: RGB(0, 255, 106), 0.605: RGB(91, 255, 0), 0.699: RGB(184, 255, 0), 0.799: RGB(255, 255, 0), 0.898: RGB(255, 170, 0)])
dedata = DeconstructDataObjects(Data=wind_factors.WindFactorsAnnual, Select=Slider(1, range=0..10))
flip = FlipMatrix(Data=dedata)
vdisex = VectorDisplayEx(Point=points, Vector=choose_dir, Colour=gradient, Width=Slider(3, range=0..10))
avr = Average(Input=flip)  # -> flatten(ArithmeticMean)
cluster_4 = Cluster(data=avr)  # -> S, E, data_3
cluster_5 = Cluster_3(C=points, T=Vector(0, 0, 10))
gradient_2 = Gradient(
    LowerLimit=cluster_4.S,
    UpperLimit=cluster_4.E,
    Parameter=cluster_4.data_3,
    stops=[0.103: RGB(0, 0, 255), 0.22: RGB(0, 170, 255), 0.305: RGB(0, 255, 255), 0.398: RGB(0, 255, 188), 0.504: RGB(0, 255, 106), 0.605: RGB(91, 255, 0), 0.699: RGB(184, 255, 0), 0.799: RGB(255, 255, 0), 0.898: RGB(255, 170, 0)])
preview = CustomPreview(Geometry=cluster_5, Material=gradient_2)

pedestrian_wind_comfort = PedestrianWindComfort(
    WindFactorsSpatial=wind_factors.WindFactorsSpatial,
    WindFactorsAnnual=wind_factors.WindFactorsAnnual,
    WindComfortMetric=4,
    Weibull_Fit=True)  # -> WindComfortRank, WindComfortClassLetter, WindComfortClass; disabled
cir = Circle(Plane=probing_2.ProbingPoints, Radius=1)  # disabled
srf = Surface(cir)  # disabled

# ----
# Wind Comfort Metrics
cluster_6 = Cluster(data=pedestrian_wind_comfort.WindComfortRank)  # -> S, E, data_3; disabled
gradient_3 = Gradient(
    LowerLimit=cluster_6.S,
    UpperLimit=cluster_6.E,
    Parameter=cluster_6.data_3,
    stops=[0.103: RGB(0, 0, 255), 0.22: RGB(0, 170, 255), 0.305: RGB(0, 255, 255), 0.398: RGB(0, 255, 188), 0.504: RGB(0, 255, 106), 0.605: RGB(91, 255, 0), 0.699: RGB(184, 255, 0), 0.799: RGB(255, 255, 0), 0.898: RGB(255, 170, 0)])  # disabled
tag = TextTag(Location=probing_2.ProbingPoints, Text=pedestrian_wind_comfort.WindComfortClassLetter)  # disabled
preview_2 = CustomPreview(Geometry=srf, Material=gradient_3)  # disabled

# ==== cluster Cluster
data = ClusterInput()
data_2 = Data(data)
data_3 = ClusterOutput(data_2)
bnd = Bounds(Numbers=data_2)
dedomain = DeconstructDomain(Domain=bnd)  # -> Start, End
S = ClusterOutput(dedomain.Start)
E = ClusterOutput(dedomain.End)

# ==== cluster Cluster_3
C = ClusterInput()
cluster = Cluster_2(C=C)
T = ClusterInput()
move = Move(Geometry=cluster, Motion=T)  # -> Geometry, Transform
srf = ClusterOutput(cluster)

# ==== cluster Cluster_4
geo = Geometry([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])
custom_mesh_settings = SettingsCustom(
    StitchSeams=True,
    SimplePlanes=False,
    Refine=True,
    MinCount=16,
    MaxCount=400,
    AspectRatio=20,
    MaxDistance=0,
    MaxAngle=20,
    MinEdge="1",
    MaxEdge="1")
mesh = MeshBrep(Brep=geo, Settings=custom_mesh_settings)
mjoin = MeshJoin(Meshes=mesh)
M = ClusterOutput(mjoin)

# ==== cluster Cluster_5
G = ClusterInput()
area = Area(Geometry=G)  # -> Area, Centroid
R = ClusterInput()
pdecon = Deconstruct(Point=area.Centroid)  # -> XComponent, YComponent, ZComponent
pt = ConstructPoint(XCoordinate=pdecon.XComponent, YCoordinate=pdecon.YComponent, ZCoordinate="1.75")
circle = CircleCNR(Center=pt, Normal=Vector(0, 0, 1), Radius=expr("x*0.48", R))
mesh = Mesh(circle)
mesh_2 = ClusterOutput(mesh)

# ==== cluster Cluster_2
C = ClusterInput()
circle = CircleCNR(Center=C, Normal=Vector(0, 0, 1), Radius=2)
srf = Surface(circle)
srf_2 = ClusterOutput(srf)
