# Grasshopper definition 5_PressureOnBuildingFacade.ghx (Grasshopper 1.0.7)
# plug-ins: Eddy3D

# ----
# 1. Geometry &
# Boundary Conditions
panel = Panel("C:\DIVA\WeatherData\USA_IL_Chicago-OHare.Intl.AP.725300_TMY3.epw")
panel_2 = Panel("""0
45
90
135
180
225
270
315""")
abl = ABL(WDir=panel_2, Uref="10", Zref=10, Z0=1, ZGround=0, Epw=panel)

geo = Geometry([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])

# ----
# 2. Simulation Domain
number_slider = Slider(50, range=0..1000)
domaincyl = CylindricalDomain(
    Geometry=geo,
    BCond=abl,
    BlockSize="10",
    SizeOfInnerRectangle=number_slider,
    SizeOfOuterRadius=Slider(300, range=0..1000),
    Height=Slider(80, range=0..1000))  # -> Domain, Mesh

# ----
# 4.1. Decompose and scale up Mesh
cluster = Cluster_2(data=geo)  # -> V, F

# ----
# 3. Mesh & Simulation
panel_3 = Panel("C:\test_pressure")
mset = MeshSettings(AccBuilding=2, AccFeatures="3", AccRefinement=0, AccGround=2, NLayer=3, Mode=1)

rset = RunSettings(
    NumberOfIterations="10",
    WriteInterval=20,
    NumberOfTimestepsToKeep=3,
    TurbulenceModel=1,
    RelaxationFactors=1,
    SolutionAndAlgorithmControl=0,
    PotentialFoamInitialization=False,
    RenumberMesh=True,
    NumberOfCPUs="-1",
    OperatingSystem=0)

simulation = Simulation(
    SimulationDomain=domaincyl.Domain,
    WorkingDirectory=panel_3,
    MeshSettings=mset,
    RunSettings=rset,
    RunMeshing=Button(),
    RunSimulation=Button(),
    runWithBlueCFD=True)
residuals = Residuals(Result=simulation, SelectionOfWindDirections=panel_2, X=":", Y=":", Version=1, Run=Button(), visResiduals=True)

# ----
# 4.2. Probing points & probing
panel_4 = Panel("pressure100")
visprobes = VisualizeProbes(Result=simulation, ProbingPoints=cluster.V, NameOfInstance=panel_4, NameOfField=1, Run=Button(), Culling=False)  # -> PorbingPoints, ProbingResult

# ----
# 5. Post-processing
# 5.1. Change wind direction
number_slider_2 = Slider(0, range=0..10)
branch = TreeBranch(Tree=visprobes.ProbingResult, Path=number_slider_2, MaintainPaths=True)
cluster_2 = Cluster(data=branch)  # -> S, E, data_3
gradient = Gradient(
    LowerLimit="-1",
    UpperLimit=cluster_2.E,
    Parameter=cluster_2.data_3,
    stops=[0.103: RGB(0, 0, 255), 0.22: RGB(0, 170, 255), 0.305: RGB(0, 255, 255), 0.398: RGB(0, 255, 188), 0.504: RGB(0, 255, 106), 0.605: RGB(91, 255, 0), 0.699: RGB(184, 255, 0), 0.799: RGB(255, 255, 0), 0.898: RGB(255, 170, 0)])
conmesh = ConstructMesh(Vertices=cluster.V, Faces=cluster.F, Colours=gradient)

# ----
# 6. Clean
button = Button()
clean = Clean(Directory=simulation, Mode=2, Run=button)

# ==== cluster Cluster
data = ClusterInput()
data_2 = Data(data)
data_3 = ClusterOutput(data_2)
bnd = Bounds(Numbers=data_2)
dedomain = DeconstructDomain(Domain=bnd)  # -> Start, End
S = ClusterOutput(dedomain.Start)
E = ClusterOutput(dedomain.End)

# ==== cluster Cluster_2
data = ClusterInput()
data_2 = Data(data)
debrep = DeconstructBrep(Brep=data_2)  # -> flatten(Faces), Edges, Vertices
number_slider = Slider(2, range=0..10)
area = Area(Geometry=debrep.Faces)  # -> Area, Centroid
evalsrf = EvaluateSurface(Surface=debrep.Faces, Point=area.Centroid)  # -> Point, Normal, UDirection, VDirection, Frame
move = Move(Geometry=debrep.Faces, Motion=expr("x*0.1", evalsrf.Normal))  # -> Geometry, Transform
custom_mesh_settings = SettingsCustom(
    StitchSeams=True,
    SimplePlanes=False,
    Refine=True,
    MinCount=16,
    MaxCount=400,
    AspectRatio=20,
    MaxDistance=0,
    MaxAngle=20,
    MinEdge=number_slider,
    MaxEdge=number_slider)
Z = UnitZ(Factor=1)
dprod = DotProduct(VectorA=evalsrf.Normal, VectorB=Z, Unitize=False)
scale = Scale(Geometry=move.Geometry, Center=area.Centroid, Factor=Slider(0.99, range=0..1))  # -> Geometry, Transform
larger = LargerThan(FirstNumber=dprod, SecondNumber="0")  # -> LargerThan, OrEqualTo
dispatch = Dispatch(List=scale.Geometry, DispatchPattern=larger.OrEqualTo)  # -> ListA, ListB
mesh = MeshBrep(Brep=dispatch.ListA, Settings=custom_mesh_settings)
mjoin = MeshJoin(Meshes=mesh)
demesh = DeconstructMesh(Mesh=mjoin)  # -> Vertices, Faces, Colours, Normals
F = ClusterOutput(demesh.Faces)
V = ClusterOutput(demesh.Vertices)
