# Grasshopper definition 6_AnnualOutdoorComfort.ghx (Grasshopper 1.0.7)
# plug-ins: Eddy3D

panel = Panel("https://energyplus.net/weather-download/north_and_central_america_wmo_region_4/USA/NY/USA_NY_New.York-J.F.Kennedy.Intl.AP.744860_TMY3/USA_NY_New.York-J.F.Kennedy.Intl.AP.744860_TMY3.epw")

# ----
# 2. Simulation Domain
number_slider = Slider(50, range=0..1000)

panel_2 = Panel("20")  # disabled
button = Button()  # disabled
number_slider_2 = Slider(0, range=0..100)
number_slider_3 = Slider(5, range=0..100)

# ----
# 1. Geometry &
# Boundary Conditions
panel_3 = Panel("""0
45
90
135
180
225
270
315""")
geo = Geometry([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])

# ----
# 3. Mesh & Simulation
panel_4 = Panel("2")
mset = MeshSettings(AccBuilding=2, AccFeatures="3", AccRefinement=0, AccGround=2, NLayer=panel_4, Mode=2)

downloadepw = CSharpScript(epwURL=panel, folder="C:\test_cyl", download=Button())  # -> path; inputs epwURL: String, folder: String, download: Boolean
# ---------- downloadepw: C# usings ----------
using System.Net;
# ---------- downloadepw: C# ----------
    if (download == true){

      DownLoadFile(epwURL, folder + "\\weather.epw");



    }

    path = folder + "\\weather.epw";
# ---------- downloadepw: C# additional code ----------
  public static void DownLoadFile(string URL, string FilePath)
  {
    WebClient webClient = new WebClient();
    webClient.DownloadFile(URL, FilePath);
  }
# ---------- end downloadepw ----------

abl = ABL(WDir=panel_3, Uref=5, Zref=10, Z0=1, ZGround=0, Epw=downloadepw)

domaincyl = CylindricalDomain(
    Geometry=geo,
    BoundaryCondition=abl,
    BlockSize="10",
    SizeOfInnerRectangle=number_slider,
    SizeOfOuterRadius=Slider(300, range=0..1000),
    Height=Slider(80, range=0..1000))  # -> Domain, Mesh
rset = RunSettings(
    NumberOfIterations="60",
    WriteInterval=20,
    NumberOfTimestepsToKeep=3,
    TurbulenceModel=1,
    RelaxationFactors=1,
    SolutionAndAlgorithmControl=0,
    PotentialFoamInitialization=False,
    NumberOfCPUs="1",
    OperatingSystem=0)

simulation = Simulation(
    SimulationDomain=domaincyl.Domain,
    WorkingDirectory="C:\test_cyl",
    MeshSettings=mset,
    RunSettings=rset,
    RunMeshing=Button(),
    RunSimulation=Button(),
    runWithBlueCFD=True)
residuals = Residuals(Result=simulation, SelectionOfWindDirections=panel_3, X=":", Y=":", Version=1, Run=Button(), visResiduals=True)

# ----
# 4. Probing points & probing
number_slider_4 = Slider(4, range=1..50)
brep = Brep(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)
meshplane = MeshPlane(brep=brep, number=number_slider_4, B=geo)  # -> L, faces
visprobes = VisualizeProbes(Result=simulation, ProbingPoints=meshplane.L, NameOfInstance="test", NameOfField=0, Run=Button(), Culling=True)  # -> PorbingPoints, ProbingResult

# ----
# 6. Clean
button_2 = Button()
clean = Clean(Directory="C:\test_cyl", Mode=2, Run=button_2)

# ----
# Write your custom MRT file here!
c_script = CSharpScript(points=visprobes.PorbingPoints, MRT=panel_2)  # -> out, A; inputs points: list of Double, MRT: Double; disabled
# ---------- c_script: C# usings ----------
using System.Linq;
# ---------- c_script: C# ----------
    var tree = new DataTree<double>();

    var numberOfPoints = points.Count;

    for (int h = 0; h < 8760 ; h++){
      List<double> hv = Enumerable.Repeat(MRT, numberOfPoints).ToList();
      tree.AddRange(hv, new GH_Path(h));
      //  for(int p = 0; p < numberOfPoints; p++){


      //  }

    }

    A = tree;
# ---------- end c_script ----------
wind_factors = WindFactors(Result=simulation, ProbingPoints=visprobes.PorbingPoints, WindVelocity=visprobes.ProbingResult, Interpolation=False)  # -> WindFactorsSpatial, WindFactorsAnnual
bin = CSharpScript(caseFolder="C:\test_cyl", Tree=c_script.A, Run=button)  # inputs caseFolder: String, Tree: tree of Double, Run: Boolean; disabled
# ---------- bin: C# usings ----------
using System.IO;
using System.Linq;
# ---------- bin: C# ----------
    if (Run == true)
    {


      string fileName = "\\MRT.bin";


      writeBin(caseFolder + fileName, To2DArrayGen(Tree));



    }
# ---------- bin: C# additional code ----------
  public static double[,] To2DArrayGen(DataTree<double> tree)
  {
    double[,] result = new double[tree.Branches.Count, tree.Branches[0].Count];



    for (int i = 0; i < tree.Branches.Count; i++)
    {
      for (int j = 0; j < tree.Branches[0].Count; j++)
      {
        if (tree.Branches[i].Count != tree.Branches[0].Count) throw new InvalidOperationException("The list cannot contain elements (lists) of different sizes.");
        result[i, j] = tree.Branches[i][j];   //[i];
      }
    }
    return result;
  }


  public static void writeBin(string fileName, double[,] values)
  {
    // [i, time j] points

    BinaryWriter bw;

    //create the file
    try
    {
      bw = new BinaryWriter(new FileStream(fileName, FileMode.Create));
    }
    catch (IOException e)
    {
      Console.WriteLine(e.Message + "\n Cannot create file.");
      return;
    }

    //writing into the file
    try
    {
      bw.Write((Int32) values.GetLength(0));
      bw.Write((Int32) values.GetLength(1));

      for (int i = 0; i < values.GetLength(0); i++)
      {
        for (int j = 0; j < values.GetLength(1); j++)
        {
          float fval = (float) values[i, j];
          bw.Write(fval);
        }
      }
    }
    catch (IOException e)
    {
      Console.WriteLine(e.Message + "\n Cannot write to file.");
      return;
    }
    bw.Close();
  }
# ---------- end bin ----------

# ----
# 5. Post-processing
# Don't click run if you provide your own data.
# Multi-directional / annual wind vectors
# 5.2. Grasshopper
button_3 = Button()
button_4 = Button()
dir = Slider(2, range=0..7)  # disabled
points = Data(visprobes.PorbingPoints)  # disabled
vectors = Data(visprobes.ProbingResult)  # disabled
mean_radiant_temperature = MeanRadiantTemperature(SimulationResult=simulation, ProbingPoints=visprobes.PorbingPoints, SimulationMode=0, Run=button_3)
choose_dir = TreeBranch(Tree=vectors, Path=dir, MaintainPaths=True)  # disabled
number_slider_5 = Slider(6, range=0..10)  # disabled
cluster = Cluster(data=choose_dir)  # -> S, E, data_3; disabled
gradient = Gradient(
    LowerLimit=cluster.S,
    UpperLimit=number_slider_5,
    Parameter=cluster.data_3,
    stops=[0.103: RGB(0, 0, 255), 0.22: RGB(0, 170, 255), 0.305: RGB(0, 255, 255), 0.398: RGB(0, 255, 188), 0.504: RGB(0, 255, 106), 0.605: RGB(91, 255, 0), 0.699: RGB(184, 255, 0), 0.799: RGB(255, 255, 0), 0.898: RGB(255, 170, 0)])  # disabled
dedata = DeconstructData(In=wind_factors.WindFactorsAnnual, Hours=Slider(1569, range=0..10000))
number_slider_6 = Slider(3, range=0..10)  # disabled
vdisex = VectorDisplayEx(Point=points, Vector=choose_dir, Colour=gradient, Width=number_slider_6)  # disabled
cluster_2 = Cluster_2(C=visprobes.PorbingPoints, R=Slider(2, range=0..10))

outdoor_thermal_comfort = OutdoorThermalComfort(
    SimulationResult=simulation,
    ProbingPoints=visprobes.PorbingPoints,
    WindFactorsAnnual=wind_factors.WindFactorsAnnual,
    MeanRadiantTemperature=mean_radiant_temperature,
    Run=Button())  # -> UniversalThermalClimateIndexCObject, ComfortableHours
cluster_3 = Cluster_3(D=dedata)  # -> flatten(am)

cluster_4 = Cluster(data=cluster_3)  # -> S, E, data_3
gradient_2 = Gradient(
    LowerLimit=cluster_4.S,
    UpperLimit=cluster_4.E,
    Parameter=cluster_4.data_3,
    stops=[0.103: RGB(0, 0, 255), 0.22: RGB(0, 170, 255), 0.305: RGB(0, 255, 255), 0.398: RGB(0, 255, 188), 0.504: RGB(0, 255, 106), 0.605: RGB(91, 255, 0), 0.699: RGB(184, 255, 0), 0.799: RGB(255, 255, 0), 0.898: RGB(255, 170, 0)])
preview = CustomPreview(Geometry=cluster_2, Material=gradient_2)

# ==== cluster Cluster
data = ClusterInput()
data_2 = Data(data)
data_3 = ClusterOutput(data_2)
bnd = Bounds(Numbers=data_2)
dedomain = DeconstructDomain(Domain=bnd)  # -> Start, End
S = ClusterOutput(dedomain.Start)
E = ClusterOutput(dedomain.End)

# ==== cluster Cluster_2
C = ClusterInput()
R = ClusterInput()
circle = CircleCNR(Center=C, Normal=Vector(0, 0, 1), Radius=R)
srf = Surface(circle)
srf_2 = ClusterOutput(srf)

# ==== cluster Cluster_3
D = ClusterInput()
flip = FlipMatrix(Data=D)
avr = Average(Input=flip)
am = ClusterOutput(avr)

# ==== cluster MeshPlane
B = ClusterInput()
number = ClusterInput()
number_2 = Number(number)
settings_custom = SettingsCustom(
    StitchSeams=True,
    SimplePlanes=False,
    Refine=True,
    MinCount=16,
    MaxCount=400,
    AspectRatio=20,
    MaxDistance=0,
    MaxAngle=20,
    MinEdge=number_2,
    MaxEdge=number_2)
brep = ClusterInput()
mesh_brep = MeshBrep(Brep=brep, Settings=settings_custom)
deconstruct_mesh = DeconstructMesh(Mesh=mesh_brep)  # -> Vertices, Faces, Colours, Normals
brepsinc = PointInBreps(Brep=B, Point=deconstruct_mesh.Vertices, Strict=False)  # -> Inside, Index
not = GateNot(A=brepsinc.Inside)
cull = CullPattern(List=deconstruct_mesh.Vertices, CullPattern=not)
faces = ClusterOutput(deconstruct_mesh.Faces)
L = ClusterOutput(cull)
