# Grasshopper definition 7_IndoorExample.ghx (Grasshopper 1.0.7)
# plug-ins: Eddy3D

# ----
# Room Boundary Geometry
number_slider = Slider(49, range=0..100)
# Eddy3D Indoor Example
# Step 1: Imput Geometry
geo = Geometry(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)
geo_2 = Geometry(Geo=geo, Temp=number_slider)
preview = CustomPreview(Geometry=geo, Material=ColourSwatch(SwatchColor=RGBA(0, 0, 0, 63)))

# ----
# Inlet
geo_3 = Geometry(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)
facen = FaceNormals(Mesh=geo_3)  # -> Centers, Normals
il = Inlet(Geo=geo_3, Vel=facen.Normals, Temp=Slider(20, range=0..100))
preview_2 = CustomPreview(Geometry=geo_3, Material=ColourSwatch(SwatchColor=RGB(95, 160, 255)))

# ----
# Outlet
geo_4 = Geometry(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)
ol = Outlet(Geo=geo_4, Vel=Vector(0, 0, 0))
preview_3 = CustomPreview(Geometry=geo_4, Material=ColourSwatch(SwatchColor=RGB(255, 0, 12)))

# ---- group: For any new case, please make sure to put it in a "0" subfolder.
panel = Panel("C:\temp\EddyProject\0\")

# ----
# Point Inside Boundary
pt = Point(Point(-1.876191958, -1.534687347, 1.727068955))

# ----
# Step 2: Run Simulation
number_slider_2 = Slider(2, range=0..10)
# Step 3: Probing
idom = IndoorDomain(
    Geo=geo_2,
    Inlet=il,
    Outlet=ol,
    Directory=panel,
    PointInside=pt,
    CellSize=number_slider_2,
    Iterations=Slider(100, range=0..100),
    Run=Button())  # -> Domain, Result

brep = Brep(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)
brep_2 = Brep(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)
cluster = Cluster(B=brep_2, cutter=geo, relay=Slider(0.5, range=0..1))  # -> V, M
probing = Probing(Result=idom.Result, ProbingPoints=cluster.V, NameOfField=0, Run=Button())  # -> PorbingPoints, ProbingResult

cluster_2 = Cluster_2(V=probing.ProbingResult, M=cluster.M)  # -> cm, color

vdisex = VectorDisplayEx(Point=probing.PorbingPoints, Vector=probing.ProbingResult, Colour=cluster_2.color, Width=2)

# ==== cluster Cluster
relay = ClusterInput()
cutter = ClusterInput()
B = ClusterInput()
split = SplitBrep(Brep=B, Cutter=cutter)
custom_mesh_settings = SettingsCustom(
    StitchSeams=True,
    SimplePlanes=False,
    Refine=True,
    MinCount=16,
    MaxCount=400,
    AspectRatio=20,
    MaxDistance=0,
    MaxAngle=20,
    MinEdge=relay,
    MaxEdge=relay)
item = ListItem(List=split, Index="1", Wrap=True)
mesh = MeshBrep(Brep=item, Settings=custom_mesh_settings)
demesh = DeconstructMesh(Mesh=mesh)  # -> Vertices, Faces, Colours, Normals
M = ClusterOutput(mesh)
V = ClusterOutput(demesh.Vertices)

# ==== cluster Cluster_2
V = ClusterInput()
vlen = VectorLength(Vector=V)
smaller = SmallerThan(FirstNumber=vlen, SecondNumber="1")  # -> SmallerThan, OrEqualTo
bnd = Bounds(Numbers=smaller.SmallerThan)
dedomain = DeconstructDomain(Domain=bnd)  # -> Start, End
panel = Panel(vlen)
gradient = Gradient(
    LowerLimit=dedomain.Start,
    UpperLimit=dedomain.End,
    Parameter=vlen,
    stops=[0: RGB(234, 38, 0), 0.25: RGB(234, 126, 0), 0.5: RGB(254, 244, 84), 0.75: RGB(173, 203, 249), 1: RGB(75, 107, 169)])
M = ClusterInput()
mcol = MeshColours(Mesh=M, Colours=gradient)
color = ClusterOutput(gradient)  # color
cm = ClusterOutput(mcol)  # Colorized Mesh
