# Grasshopper definition testingEddyRadSim.gh (Grasshopper 1.0.7)
# plug-ins: DIVA Daylight, ClimateStudioGH, Eddy3D

panel = Panel("""void plastic PlasterFloor_70
0
0
5 0.7 0.7 0.7 0 0 """)
brep = Brep([<brep referenced from the Rhino model> x2])
brep_2 = Brep(<brep referenced from the Rhino model>)
brep_3 = Brep(<brep referenced from the Rhino model>)
brep_4 = Brep(<brep referenced from the Rhino model>)
panel_2 = Panel("""10
12
14
16""")
custom_mesh_settings = SettingsCustom(
    StitchSeams=True,
    SimplePlanes=False,
    Refine=True,
    MinCount=16,
    MaxCount=400,
    AspectRatio=20,
    MaxDistance=0,
    MaxAngle=20,
    MinEdge="5",
    MaxEdge="5")
brep_5 = Brep(<brep referenced from the Rhino model>)
vegsurf = VegetationSurface(Brep=brep_4, Patch="5", SimType=0)
vegsurf_2 = VegetationSurface(Brep=brep_2, Patch="5", SimType=2, Temp=panel_2)
tree = Tree(Brep=brep_3, Patch="5", Type=1)
radsurf = RadiationSurface(Brep=brep, Patch="5", Material=panel, SimType=0)
sen = Sensor(Point=Point(0, 0, 0), Normal=Vector(0, 0, 1))
mesh = MeshBrep(Brep=brep_5, Settings=custom_mesh_settings)
python = GhPythonScript(x=tree)  # -> out, a, b
# ---------- python: Python ----------
__author__ = "Timur"
__version__ = "2021.03.03"

import rhinoscriptsyntax as rs


a = x.HighPoly
b = x.LowPoly
# ---------- end python ----------
python_2 = GhPythonScript(x=radsurf)  # -> out, a
# ---------- python_2: Python ----------
__author__ = "Timur"
__version__ = "2021.03.15"

import rhinoscriptsyntax as rs

a = x.TemperatureOverride
# ---------- end python_2 ----------
mesh_2 = Mesh(python.a)
hoy = HourOfYear(Month="4", Day=21, Hour="14")  # -> HourOfYear, DayOfYear
rad = RadSystem(
    Name="MyStudy",
    Dir="C:\Temp\Eddy 3d",
    Weather="C:\Eddy3D\Weather\USA_NY_New.York-LaGuardia.AP.725030_TMY3.epw",
    RSurf=[radsurf, vegsurf_2, tree, vegsurf],
    Probes=[sen, mesh],
    Run=Button())  # -> RadSystem, Result
panel_3 = Panel(hoy.HourOfYear)
toggle = BooleanToggle(True)
lrad = LoadRadiation(Path=rad.Result, Hour=panel_3, Load=toggle)  # -> Result, Meshes, Probes, Hour
c_script = CSharpScript(x=lrad.Result, Reference="C:\Users\Timur\Dropbox\_CSHARP_PROJECTS\Eddy3d\Build\Dotfuscated\EddyLib.dll")  # -> out, A, B
# ---------- c_script: C# usings ----------
using EddyLib.Radiation;
# ---------- c_script: C# ----------
    MRTSimulationResultProto res = (MRTSimulationResultProto) x;

    var list = new List<Mesh> ();
    foreach (var p in res.Polys){

      if(p.SeenByProbes > 0.05){
        list.Add(p.Mesh.Value);
      }

    }


    A = list;
# ---------- end c_script ----------

c_script_2 = CSharpScript(x=lrad.Result, si="0", Reference="C:\Users\Timur\Dropbox\_CSHARP_PROJECTS\Eddy3d\Build\Dotfuscated\EddyLib.dll")  # -> out, A, B; inputs si: Int32
# ---------- c_script_2: C# ----------
    MRTSimulationResultProto res = (MRTSimulationResultProto) x;

    var list = new List<float> ();

    list.AddRange(res.Probes[res.Probes.Count - 1].SolarGain_dMRT);


    A = list;
    B = res.Probes[res.Probes.Count - 1].Point.Value;
# ---------- end c_script_2 ----------
gradient = GetCSGradient(Steps=0, UnitSystem=4)
bnd = Bounds(Numbers=c_script_2.A)
falsecolor = ConstructCSFalsecolor(GradientS=gradient, DomainS=bnd, UnitSystem=4)
plothr = CSPlotHourlyData(
    Data=c_script_2.A,
    Falsecolor=falsecolor,
    Input_0_Hidden=False,
    Input_0_Name="Data",
    Input_1_Hidden=False,
    Input_1_Name="Falsecolor",
    Input_2_Hidden=False,
    Input_2_Name="File Path",
    UnitSystem=4)

# ----
# comparing DDS simulation to weather file total horizontal radiation
weather = Weather(
    Location="USA_NY_New.York-LaGuardia.AP.725030_TMY3",
    Input_0_Hidden=False,
    Input_0_Name="Location",
    Output_0_Hidden=False,
    Output_0_Name="Location",
    Output_10_Hidden=False,
    Output_10_Name="DiffuseHorizontalRadiation",
    Output_11_Hidden=False,
    Output_11_Name="GlobalHorizontalRadiation",
    Output_12_Hidden=True,
    Output_12_Name="SkyCover",
    Output_13_Hidden=True,
    Output_13_Name="Precipitation",
    Output_14_Hidden=True,
    Output_14_Name="Elev",
    Output_15_Hidden=True,
    Output_15_Name="Azimuth",
    Output_16_Hidden=True,
    Output_16_Name="Vector",
    Output_17_Hidden=True,
    Output_17_Name="Illuminance",
    Output_18_Hidden=True,
    Output_18_Name="DateTime",
    Output_19_Hidden=True,
    Output_19_Name="DryBulbAverages",
    Output_1_Hidden=True,
    Output_1_Name="Latitude",
    Output_20_Hidden=True,
    Output_20_Name="DewPointAverages",
    Output_21_Hidden=True,
    Output_21_Name="DryBulbMinima"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)  # -> Location, DryBulbTemp, RelativeHumidity, DirectNormalRadiation, DiffuseHorizontalRadiation, GlobalHorizontalRadiation
c_script_3 = CSharpScript(x=lrad.Result, si="0", Reference="C:\Users\Timur\Dropbox\_CSHARP_PROJECTS\Eddy3d\Build\Dotfuscated\EddyLib.dll")  # -> out, A; inputs si: Int32
# ---------- c_script_3: C# ----------
    MRTSimulationResultProto res = (MRTSimulationResultProto) x;

    var list = new List<float> ();
    list.AddRange(res.Probes[si].DirRad);


    A = list;
# ---------- end c_script_3 ----------
c_script_4 = CSharpScript(x=lrad.Result, si="0", Reference="C:\Users\Timur\Dropbox\_CSHARP_PROJECTS\Eddy3d\Build\Dotfuscated\EddyLib.dll")  # -> out, A; inputs si: Int32
# ---------- c_script_4: C# ----------
    MRTSimulationResultProto res = (MRTSimulationResultProto) x;

    var list = new List<float> ();
    list.AddRange(res.Probes[si].TotalRad);

    A = list;
# ---------- end c_script_4 ----------
entwine = Entwine(
    Branch00=weather.GlobalHorizontalRadiation,
    Branch01=c_script_4.A,
    Branch02=c_script_3.A,
    Branch03=c_script_2.A,
    FlattenInputs=True)
panel_4 = Panel("""WeatherData
Simulation
Simulation Diffuse
SolarGain_dMRT""")
cluster = Cluster_2(doy=Slider(3, range=1..365))
subset = SubList(List=entwine, Domain=cluster, Wrap=True)  # -> List, Index
cluster_2 = Cluster(L=panel_4)  # -> C, R
xyplot = XYPlot(
    Type=0,
    Width=550,
    Height=450,
    Title="Radiation [W/m2]",
    X_rot=0,
    Y_data=subset.List,
    Colors=cluster_2.C,
    Names=panel_4,
    Show_xgrid=False,
    Show_ygrid=True,
    Legend=0)

bnd_2 = Bounds(Numbers=lrad.Hour)
inspectprobe = CSharpScript(x=lrad.Probes, si="0", Reference="C:\Users\Timur\Dropbox\_CSHARP_PROJECTS\Eddy3d\Build\Dotfuscated\EddyLib.dll")  # -> out, A, B, C; inputs x: list, si: Int32
# ---------- inspectprobe: C# usings ----------
using EddyLib.Radiation;
using System.Linq;
# ---------- inspectprobe: C# ----------
    EddyLib.Radiation.RProbe res = (EddyLib.Radiation.RProbe) x[si];

    var keylist = new List<string> ();

    var list = new List<double> ();

    list.AddRange(res.VFtoMaterial.Values.ToList());

    keylist.AddRange(res.VFtoMaterial.Keys.ToList());

    A = res.Point.Value;
    B = keylist;
    C = list;
# ---------- end inspectprobe ----------
dedomain = DeconstructDomain(Domain=bnd_2)  # -> Start, End
panel_5 = Panel([inspectprobe.B, inspectprobe.C])
gradient_2 = Gradient(
    LowerLimit=0,
    UpperLimit=dedomain.End,
    Parameter=lrad.Hour,
    stops=[0: RGB(0, 0, 255), 0.5: RGB(255, 255, 0), 1: RGB(255, 0, 0)])
panel_6 = Panel(bnd_2)
mcol = MeshColours(Mesh=lrad.Meshes, Colours=gradient_2)
X = UnitX(Factor="100")
move = Move(Geometry=mcol, Motion=X)  # -> Geometry, Transform

therm = Thermal(Res=lrad.Result, Run=Button())  # -> ThermSys, Result
lrad_2 = LoadRadiation(Path=therm.Result, Hour=panel_3, Load=toggle)  # -> Result, Meshes, Probes, Hour
inspectprobe_2 = CSharpScript(x=lrad_2.Probes, si="0", Reference="C:\Users\Timur\Dropbox\_CSHARP_PROJECTS\Eddy3d\Build\Dotfuscated\EddyLib.dll")  # -> out, A, B, C; inputs x: list, si: Int32
# ---------- inspectprobe_2: C# ----------
    EddyLib.Radiation.RProbe res = (EddyLib.Radiation.RProbe) x[si];


    var list = new List<float> ();
    var dirlist = new List<float> ();

    list.AddRange(res.LongWave_MRT);
    dirlist.AddRange(res.SolarGain_dMRT);

    A = res.Point.Value;
    B = list;
    C = dirlist;
# ---------- end inspectprobe_2 ----------
gradient_3 = GetCSGradient(Steps=0, UnitSystem=4)
addition = Addition(A=inspectprobe_2.B, B=inspectprobe_2.C)
bnd_3 = Bounds(Numbers=addition)
falsecolor_2 = ConstructCSFalsecolor(GradientS=gradient_3, DomainS=bnd_3, UnitSystem=4)
plothr_2 = CSPlotHourlyData(
    Data=addition,
    Falsecolor=falsecolor_2,
    Input_0_Hidden=False,
    Input_0_Name="Data",
    Input_1_Hidden=False,
    Input_1_Name="Falsecolor",
    Input_2_Hidden=False,
    Input_2_Name="File Path",
    UnitSystem=4)
panel_7 = Panel(bnd_3)

# ==== cluster Cluster
L = ClusterInput()
lng = ListLength(List=L)
series = Series(Start=0, Step=1, Count=lng)
gradient = Gradient(
    LowerLimit=0,
    UpperLimit=lng,
    Parameter=series,
    stops=[0: RGB(243, 57, 0), 0.1: RGB(236, 27, 60), 0.2: RGB(210, 0, 118), 0.3: RGB(103, 0, 120), 0.4: RGB(39, 72, 161), 0.5: RGB(1, 192, 229), 0.6: RGB(18, 178, 90), 0.7: RGB(79, 186, 8), 0.8: RGB(220, 237, 32), 0.9: RGB(247, 159, 20), 1: RGB(243, 57, 0)])
concat = Concatenate(FragmentA="Panel ", FragmentB=series)
C = ClusterOutput(gradient)
R = ClusterOutput(concat)

# ==== cluster Cluster_2
doy = ClusterInput()
md = MonthAndDay(DayOfYearIndex=doy)  # -> Month, Day
hoy = HourOfYear(Month=md.Month, Day=md.Day, Hour=1)
multiplication = Multiplication(A="24", B="7")
addition = Addition(A=hoy, B=multiplication)
dom = ConstructDomain(DomainStart=hoy, DomainEnd=addition)
I = ClusterOutput(dom)
